vi "Create.gvi"   [G Web Development Software 22.0.0]
inputs:
  "InnerText (None)": string
  "Tag": string, required
  "Attributes": "Attribute.gtype"[]
  "Classes": string[]
outputs:
  "Element": "JS Ref.gtype"
types:
  "Attribute.gtype" = cluster{"Name": string, "Value": string}
  "JS Ref.gtype" = "NI.JavaScriptReference"
uses:
  DOM::Support::DOM.jsli::Create
diagram:
  Flatten To Json(anything=$Attributes) -> (JSON string=w1)
  Flatten To Json(anything=$Classes) -> (JSON string=w2)
  call "Create"(tag=$Tag, attributesJSON=w1, classesJSON=w2, innerText=$"InnerText (None)") -> (Element=w3)
  $Element <- w3
