vi "InsertAdjacentElement.gvi"   [G Web Development Software 22.0.0]
inputs:
  "Element In": "JS Ref.gtype", required
  "Target": "JS Ref.gtype", required
  "Position (beforeend)": "Insert Position.gtype" = "beforeend"
outputs:
  "Element": "JS Ref.gtype"
types:
  "JS Ref.gtype" = "NI.JavaScriptReference"
  "Insert Position.gtype" = enum{"beforebegin", "afterbegin", "beforeend", "afterend"}
uses:
  DOM::Support::DOM.jsli::InsertAdjacentElement
diagram:
  Format Into String($"Position (beforeend)") -> w1
  call "InsertAdjacentElement"(target=$Target, position=w1, element=$"Element In") -> (Element out=w2)
  $Element <- w2
