vi "Add Element Column.gvi"   [G Web Development Software 22.0.0]
inputs:
  "Row In": "JS Ref.gtype"
  "Attributes (None)": "Attribute.gtype"[]
  "Classes (None)": string[]
  "Element": "JS Ref.gtype"
outputs:
  "Row": "JS Ref.gtype"
  "Column": "JS Ref.gtype"
types:
  "JS Ref.gtype" = "NI.JavaScriptReference"
  "Attribute.gtype" = cluster{"Name": string, "Value": string}
uses:
  DOM::Table::Add Text Column.gvi
  DOM::Element::InsertAdjacentElement.gvi
diagram:
  call "Add Text Column.gvi"(Row In=$"Row In", Attributes (None)=$"Attributes (None)", Classes (None)=$"Classes (None)") -> (Row=w1, Column=w2)
  $Row <- w1
  $Column <- w2
  call "InsertAdjacentElement.gvi"(Element In=$Element, Target=w2)
