vi "Add Text Column.gvi"   [G Web Development Software 22.0.0]
inputs:
  "Row In": "JS Ref.gtype"
  "Attributes (None)": "Attribute.gtype"[]
  "Classes (None)": string[]
  "Text": string
outputs:
  "Row": "JS Ref.gtype"
  "Column": "JS Ref.gtype"
types:
  "JS Ref.gtype" = "NI.JavaScriptReference"
  "Attribute.gtype" = cluster{"Name": string, "Value": string}
uses:
  DOM::Element::Create.gvi
  DOM::Element::InsertAdjacentElement.gvi
diagram:
  call "Create.gvi"(Tag="td", Attributes=$"Attributes (None)", Classes=$"Classes (None)", InnerText (None)=$Text) -> (Element=w1)
  call "InsertAdjacentElement.gvi"(Element In=w1, Target=$"Row In") -> (Element=w2)
  $Column <- w2
  $Row <- $"Row In"
