vi "Create Table Row.gvi"   [G Web Development Software 22.0.0]
inputs:
  "Table In": "JS Ref.gtype"
  "Attributes (None)": "Attribute.gtype"[]
  "Classes (None)": string[]
  "Column Text (None)": string[]
outputs:
  "Table": "JS Ref.gtype"
  "Row": "JS Ref.gtype"
types:
  "JS Ref.gtype" = "NI.JavaScriptReference"
  "Attribute.gtype" = cluster{"Name": string, "Value": string}
uses:
  DOM::Element::Create.gvi
  DOM::Element::InsertAdjacentElement.gvi
diagram:
  $Table <- $"Table In"
  call "Create.gvi"(Tag="tr", Attributes=$"Attributes (None)", Classes=$"Classes (None)") -> (Element=w1)
  call "InsertAdjacentElement.gvi"(Element In=w1, Target=$"Table In") -> (Element=w2)
  $Row <- w2
  Is Empty Array(array=$"Column Text (None)") -> w3
  case (w3) {
    frame True { }
    frame False {
      for {
        w4 = each element of $"Column Text (None)"
        call "Create.gvi"(Tag="td", InnerText (None)=w4) -> (Element=w5)
        call "InsertAdjacentElement.gvi"(Element In=w5, Target=w1)
      }
    }
  }
