vi "Create Table.gvi"   [G Web Development Software 22.0.0]
inputs:
  "Classes (None)": string[]
  "Attributes (None)": "Attribute.gtype"[]
  "Parent": "JS Ref.gtype"
  "Column Headers (None)": string[]
outputs:
  "Table": "JS Ref.gtype"
types:
  "Attribute.gtype" = cluster{"Name": string, "Value": string}
  "JS Ref.gtype" = "NI.JavaScriptReference"
uses:
  DOM::Element::Create.gvi
  DOM::Element::InsertAdjacentElement.gvi
diagram:
  call "Create.gvi"(Tag="table", Attributes=$"Attributes (None)", Classes=$"Classes (None)") -> (Element=w1)
  call "InsertAdjacentElement.gvi"(Element In=w1, Target=$Parent) -> (Element=w2)
  Is Empty Array(array=$"Column Headers (None)") -> w3
  case (w3) {
    frame True {
      w4 = w2
    }
    frame False {
      call "Create.gvi"(Tag="tr") -> (Element=w5)
      s1 = w5  # shift register
      for {
        w6 = each element of $"Column Headers (None)"
        call "Create.gvi"(Tag="th", InnerText (None)=w6) -> (Element=w7)
        call "InsertAdjacentElement.gvi"(Element In=w7, Target=s1)
      }
      call "InsertAdjacentElement.gvi"(Element In=s1, Target=w2)
      w4 = w2
    }
  }
  $Table <- w4
