vi "AddPendingSubmission.gvi"   [G Web Development Software 22.0.0]
panel controls:
  "Table In": "JS Ref.gtype"
  "Submission Details JSON": "Pending Submission JSON.gtype"
panel indicators:
  "Table": "JS Ref.gtype"
  "Row": "JS Ref.gtype"
types:
  "JS Ref.gtype" = "NI.JavaScriptReference"
  "Pending Submission JSON.gtype" = cluster{"sub_id": i64, "user_id": i64, "chal_id": i64, "submitted": string, "first_name": string, "last_name": string, "email": string, "department": string, "challenge": string}
uses:
  DOM::Table::Create Table Row.gvi
  DOM::Element::Create.gvi
  DOM::Table::Add Element Column.gvi
diagram:
  Property Node(instance in=$"Submission Details JSON") -> ("ID"=w1, "Challenge"=w2, "User"=w3, "Submitted"=w4)
  Number To Decimal String(number=w1) -> (decimal integer string=w5)
  Build Array(w5, w2, w3, w4) -> w6
  call "Create Table Row.gvi"(Column Text (None)=w6, Table In=$"Table In") -> (Table=w7, Row=w8)
  $Table <- w7
  call "Create.gvi"(Tag="button", InnerText (None)="Approve") -> (Element=w9)
  call "Add Element Column.gvi"(Element=w9, Row In=w8) -> (Row=w10)
  $Row <- w10
