vi "Approve.gvi"   [G Web Development Software 22.0.0]
inputs:
  "Submission ID": i64
outputs:
  "error out": error
uses:
  NI::HTTP::GET.gvi
  NI::G Core::Error::Build Error Cluster.gvi
diagram:
  Number To Decimal String(number=$"Submission ID") -> (decimal integer string=w1)
  Concatenate Strings("/approve/", w1) -> w2
  call "GET.gvi"(url=w2) -> (status code=w3, error out=w4)
  case (w3) {
    frame Default {
      call "Build Error Cluster.gvi"(error in=w4, code=w3) -> (error out=w5)
    }
    frame 200 {
      w5 = default
    }
  }
  $"error out" <- w5
