vi "GET Admin Info.gvi"   [G Web Development Software 22.0.0]
outputs:
  "Admin Info": "Admin Info JSON.gtype"
  "error out": error
types:
  "Pending Submission JSON.gtype" = cluster{"sub_id": i64, "user_id": i64, "chal_id": i64, "submitted": string, "first_name": string, "last_name": string, "email": string, "department": string, "challenge": string, "score": f64}
  "Admin Info JSON.gtype" = cluster{"Pending": "Pending Submission JSON.gtype"[], "Running": "Pending Submission JSON.gtype"[], "Completed": "Pending Submission JSON.gtype"[]}
uses:
  NI::HTTP::GET.gvi
  NI::G Core::Error::Build Error Cluster.gvi
diagram:
  call "GET.gvi"(url="/admininfo") -> (status code=w1, body=w2, error out=w3)
  case (w1) {
    frame Default {
      call "Build Error Cluster.gvi"(error in=w3, code=w1) -> (error out=w4)
      w5 = default
    }
    frame 200 {
      Unflatten From Json(JSON string=w2, error in (no error)=w3, type and defaults="Admin Info JSON.gtype" {all zero or empty}) -> (error out=w4, value=w5)
    }
  }
  $"Admin Info" <- w5
  $"error out" <- w4
