vi "Populate Admin.gvi"   [G Web Development Software 22.0.0]
inputs:
  "Pending": "DataGrid reference"
  "Running": "DataGrid reference"
  "Done": "DataGrid reference"
  "Filter Completed": bool
types:
  T1 = cluster{"ID": f64, "Challenge": string, "Approve": bool, "User": string, "Submitted": string}
  T2 = cluster{"ID": f64, "Challenge": string, "User": string, "Submitted": string}
  T3 = cluster{"ID": f64, "Challenge": string, "User": string, "Submitted": string, "Score": f64, "Summary": string}
uses:
  WebApp::Support::Admin::GET Admin Info.gvi
diagram:
  call "GET Admin Info.gvi"() -> (Admin Info=w1)
  Property Node(instance in=w1) -> ("Pending"=w2, "Running"=w3, "Completed"=w4)
  for {
    w5 = each element of w2
    Property Node(instance in=w5) -> ("sub_id"=w7, "challenge"=w8, "submitted"=w9, "first_name"=w10, "last_name"=w11, "email"=w12, "department"=w13)
    Concatenate Strings(w10, " ", w11, " ", w12, " ", w13) -> w14
    Property Node(instance in=T1 {all zero or empty}, "ID"=w7, "Challenge"=w8, "Approve"=FALSE, "Submitted"=w9, "User"=w14) -> (instance out=w15)
    append w15 to w6
  }
  Property Node(instance in=$Pending, "Value"=w6)
  for {
    w16 = each element of w3
    Property Node(instance in=w16) -> ("sub_id"=w18, "challenge"=w19, "submitted"=w20, "first_name"=w21, "last_name"=w22, "email"=w23, "department"=w24)
    Concatenate Strings(w21, " ", w22, " ", w23, " ", w24) -> w25
    Property Node(instance in=T2 {all zero or empty}, "ID"=w18, "Challenge"=w19, "Submitted"=w20, "User"=w25) -> (instance out=w26)
    append w26 to w17
  }
  Property Node(instance in=$Running, "Value"=w17)
  Not(x=$"Filter Completed") -> w27
  for {
    w28 = each element of w4
    Property Node(instance in=w28) -> ("sub_id"=w30, "challenge"=w31, "submitted"=w32, "score"=w33, "first_name"=w34, "last_name"=w35, "email"=w36, "department"=w37, "summary"=w38)
    Concatenate Strings(w34, " ", w35, " ", w36, " ", w37) -> w39
    Property Node(instance in=T3 {all zero or empty}, "ID"=w30, "Challenge"=w31, "Submitted"=w32, "Score"=w33, "User"=w39, "Summary"=w38) -> (instance out=w40)
    Is Greater Than 0(x=w33) -> w41
    Logical Or(w41, w27) -> w42
    append w40 to w29 if w42
  }
  Property Node(instance in=$Done, "Value"=w29)
