vi "Login.gvi"   [G Web Development Software 22.0.0]
inputs:
  "Login JSON": "Login JSON.gtype"
types:
  "Login JSON.gtype" = cluster{"Email": string, "Password": string, "CSRF": string}
uses:
  WebApp::Support::POST with Type.gvi
  NI::G Core::Error::Read Error Code.gvi
  SweetAlert::Advanced::Configure::Base Options.gvi
  SweetAlert::Advanced::Configure::Cancel Button Options.gvi
  SweetAlert::Advanced::Operate::Open Sweet Alert.gvi
  URL::Window Location::Window Location Set.gvi
diagram:
  w1 = "<span>If you need assistance with login, head over to our <a href=\"https://web.yammer.com/main/groups/eyJfdHlwZSI6Ikdyb3VwIiwiaWQiOiIxMDUxNDYzNzYxOTIifQ/all\" target=\"_blank\">Yammer</a> to let us know about the issue or reach out to Derrick Bommarito on Teams.</span>"
  Flatten To Json(anything=$"Login JSON") -> (JSON string=w2)
  call "POST with Type.gvi"(URL="/login", Buffer=w2) -> (status code=w3, body=w4, error out=w5)
  case (w5) {
    frame Error, Default {
      call "Read Error Code.gvi"(error in=w5) -> (code=w6)
      Format Into String(formatString="POST error %d. Please try again.", w6) -> w7
      call "Base Options.gvi"(footer=w1, title="Login Failed", message=w7, icon="error") -> (options out=w8)
      call "Cancel Button Options.gvi"(options in=w8, enable?=FALSE) -> (options out=w9)
      call "Open Sweet Alert.gvi"(options=w9)
    }
    frame No Error {
      case (w3) {
        frame Default {
          Format Into String(formatString="Unknown error %d. Please try again.", w3) -> w10
          call "Base Options.gvi"(footer=w1, title="Login Failed", message=w10, icon="error") -> (options out=w11)
          call "Cancel Button Options.gvi"(options in=w11, enable?=FALSE) -> (options out=w12)
          call "Open Sweet Alert.gvi"(options=w12)
        }
        frame 200 {
          call "Window Location Set.gvi"(url=w4)
        }
        frame 401 {
          call "Base Options.gvi"(footer=w1, title="Login Failed", message="Incorrect login credentials. Please try again.", icon="error") -> (options out=w13)
          call "Cancel Button Options.gvi"(options in=w13, enable?=FALSE) -> (options out=w14)
          call "Open Sweet Alert.gvi"(options=w14)
        }
      }
    }
  }
