vi "Make CSRF Token.gvi"   [G Web Development Software 22.0.0]
inputs:
  "Token ID": string
outputs:
  "error out": error
  "Token": string
uses:
  WebApp::Support::POST with Type.gvi
diagram:
  call "POST with Type.gvi"(URL="/csrf", Buffer=$"Token ID") -> (body=w1, error out=w2)
  Select(s=w2, t="", f=w1) -> w3
  $Token <- w3
  $"error out" <- w2
