vi "GET Challenge by ID.gvi"   [G Web Development Software 22.0.0]
inputs:
  "ID": i64
  "Error In": error
outputs:
  "Error Out": error
  "Challenge": "Challenge JSON.gtype"
  "Found?": bool
types:
  "Challenge JSON.gtype" = cluster{"id": i64, "name": string, "description": string, "download": string, "instructions": string}
uses:
  NI::HTTP::GET.gvi
diagram:
  Number To Decimal String(number=$ID) -> (decimal integer string=w1)
  Concatenate Strings("/challenges?id=", w1) -> w2
  call "GET.gvi"(url=w2, error in=$"Error In") -> (status code=w3, body=w4, error out=w5)
  case (w3) {
    frame Default {
      w6 = "Challenge JSON.gtype" {all zero or empty}
      w7 = w5
      w8 = FALSE
    }
    frame 200 {
      Unflatten From Json(JSON string=w4, error in (no error)=w5, type and defaults="Challenge JSON.gtype"[] []) -> (error out=w7, value=w9)
      Array Index(array=w9) -> (out0[_]=w6)
      w8 = TRUE
    }
  }
  $Challenge <- w6
  $"Error Out" <- w7
  $"Found?" <- w8
