vi "GET Challenges.gvi"   [G Web Development Software 22.0.0]
outputs:
  "Challenges": "Challenge JSON.gtype"[]
  "Error": error
types:
  "Challenge JSON.gtype" = cluster{"id": i64, "name": string, "description": string, "download": string, "instructions": string}
uses:
  NI::HTTP::GET.gvi
diagram:
  call "GET.gvi"(url="/challenges") -> (status code=w1, body=w2, error out=w3)
  case (w1) {
    frame Default {
      w4 = default
      w5 = w3
    }
    frame 200 {
      Unflatten From Json(JSON string=w2, type and defaults="Challenge JSON.gtype"[] []) -> (error out=w5, value=w4)
    }
  }
  $Challenges <- w4
  $Error <- w5
