vi "Set Challenge Details.gvi"   [G Web Development Software 22.0.0]
inputs:
  "Name Ref": "Text reference"
  "Challenge": "Challenge JSON.gtype"
  "Desc Ref": "NI.JavaScriptReference"
types:
  "Challenge JSON.gtype" = cluster{"id": i64, "name": string, "description": string, "download": string, "instructions": string}
uses:
  WebApp::Support::Common.jsli::SetInnerHTML
diagram:
  Property Node(instance in=$Challenge) -> ("name"=w1, "description"=w2)
  Property Node(instance in=$"Name Ref", "Text"=w1)
  call "SetInnerHTML"(placeholder=$"Desc Ref", html=w2)
