vi "GET Leaderboard.gvi"   [G Web Development Software 22.0.0]
outputs:
  "Leaderboard": "Challenge JSON.gtype"
  "Leaderboard JSON": string
  "Error": error
types:
  T1 = cluster{"Overall": f64, "Categories": cluster{"Category": string, "Value": f64}[]}
  "User Score JSON.gtype" = cluster{"first_name": string, "last_name": string, "department": string, "score": T1, "user_id": i64, "sub_id": i64, "chal_id": i64}
  "Challenge JSON.gtype" = cluster{"id": i64, "name": string, "description": string, "download": string, "instructions": string, "top_subs": "User Score JSON.gtype"[]}
uses:
  NI::HTTP::GET.gvi
diagram:
  call "GET.gvi"(url="/leaderboard") -> (status code=w1, body=w2, error out=w3)
  case (w1) {
    frame Default {
      w4 = w3
      w5 = default
      w6 = default
    }
    frame 200 {
      Unflatten From Json(JSON string=w2, type and defaults="Challenge JSON.gtype" {all zero or empty}) -> (error out=w4, value=w5)
      w6 = w2
    }
  }
  $"Leaderboard JSON" <- w6
  $Leaderboard <- w5
  $Error <- w4
