vi "POST with Type.gvi"   [G Web Development Software 22.0.0]
inputs:
  "timeout": i32 = 10000
  "URL": string
  "Buffer": string
  "Content-Type (text/plain)": string = "text/plain"
  "error in": error
outputs:
  "headers": string
  "body": string
  "status code": u32
  "error out": error
uses:
  NI::HTTP::Open HTTP Handle.gvi
  NI::HTTP::Add Header.gvi
  NI::HTTP::POST Buffer.gvi
diagram:
  call "Open HTTP Handle.gvi"(error in=$"error in") -> (client handle out=w1, error out=w2)
  call "Add Header.gvi"(client handle=w1, header="Content-Type", value=$"Content-Type (text/plain)", error in=w2) -> (client handle out=w3, error out=w4)
  call "POST Buffer.gvi"(timeout=$timeout, client handle=w3, url=$URL, buffer=$Buffer, error in=w4) -> (status code=w5, headers=w6, body=w7, error out=w8)
  $headers <- w6
  $body <- w7
  $"error out" <- w8
  $"status code" <- w5
