vi "Failed Alert.gvi"   [G Web Development Software 22.0.0]
inputs:
  "Message": string
outputs:
  "error out": error
uses:
  SweetAlert::Advanced::Configure::Base Options.gvi
  SweetAlert::Advanced::Configure::Cancel Button Options.gvi
  SweetAlert::Advanced::Operate::Open Sweet Alert.gvi
diagram:
  w1 = "<span>If you need assistance with registration, head over to our <a href=\"https://web.yammer.com/main/groups/eyJfdHlwZSI6Ikdyb3VwIiwiaWQiOiIxMDUxNDYzNzYxOTIifQ/all\" target=\"_blank\">Yammer</a> to let us know about the issue or reach out to Derrick Bommarito on Teams.</span>"
  w2 = "Your registration was unsuccessful. Please correct the issues and try again.<br/><br/>\n<i>%s</i>"
  Format Into String(formatString=w2, $Message) -> w3
  call "Base Options.gvi"(footer=w1, title="Registration Failed", message=w3, icon="error") -> (options out=w4)
  call "Cancel Button Options.gvi"(options in=w4, enable?=FALSE) -> (options out=w5)
  call "Open Sweet Alert.gvi"(options=w5) -> (error out=w6)
  $"error out" <- w6
