vi "Register User.gvi"   [G Web Development Software 22.0.0]
inputs:
  "User Registration": "User Registration.gtype"
outputs:
  "Result Message": string
  "Success": bool
types:
  "User Registration.gtype" = cluster{"Email": string, "Password 1": string, "Password 2": string, "First Name": string, "Last Name": string, "Department": string}
  "User Registration JSON.gtype" = cluster{"email": string, "password": string, "first_name": string, "last_name": string, "department": string}
uses:
  WebApp::Support::POST with Type.gvi
diagram:
  Property Node(instance in=$"User Registration") -> ("Password 1"=w1, "Password 2"=w2, "Email"=w3, instance out=w4)
  Is Not Equal(x=w1, y=w2) -> w5
  Match Pattern(regular expression="[^@]@ni\\.com", string=w3) -> (offset past match=w6)
  Is Greater Than 0(x=w6) -> w7
  case (w7) {
    frame False, Default {
      w8 = "Email is not a ni.com email address"
      w9 = FALSE
    }
    frame True {
      case (w5) {
        frame False, Default {
          Property Node(instance in=w4) -> ("Email"=w10, "Password 1"=w11, "First Name"=w12, "Last Name"=w13, "Department"=w14)
          Property Node(instance in="User Registration JSON.gtype" {all zero or empty}, "email"=w10, "password"=w11, "first_name"=w12, "last_name"=w13, "department"=w14) -> (instance out=w15)
          Flatten To Json(anything=w15) -> (JSON string=w16)
          call "POST with Type.gvi"(URL="/registration", Buffer=w16) -> (status code=w17, body=w8)
          Is Equal(x=w17, y=200) -> w9
        }
        frame True {
          w8 = "The entered passwords do not match."
          w9 = FALSE
        }
      }
    }
  }
  $"Result Message" <- w8
  $Success <- w9
