vi "Success Alert.gvi"   [G Web Development Software 22.0.0]
inputs:
  "User Registration": "User Registration.gtype"
outputs:
  "error out": error
types:
  "User Registration.gtype" = cluster{"Email": string, "Password 1": string, "Password 2": string, "First Name": string, "Last Name": string, "Department": string}
uses:
  SweetAlert::Advanced::Configure::Base Options.gvi
  SweetAlert::Advanced::Configure::Confirm Button Options.gvi
  SweetAlert::Advanced::Configure::Cancel Button Options.gvi
  SweetAlert::Advanced::Configure::Modal Window Options.gvi
  SweetAlert::Advanced::Operate::Open Sweet Alert.gvi
diagram:
  w1 = "Congratulations, %s!\nYou've successfully been registered with your NI email. You will be redirected to the login form automatically or you can click continue if you do not want to wait."
  Property Node(instance in=$"User Registration") -> ("First Name"=w2)
  Format Into String(formatString=w1, w2) -> w3
  call "Base Options.gvi"(title="Registration Successful", message=w3, icon="success") -> (options out=w4)
  call "Confirm Button Options.gvi"(options in=w4, text="Continue") -> (options out=w5)
  call "Cancel Button Options.gvi"(options in=w5, enable?=FALSE) -> (options out=w6)
  call "Modal Window Options.gvi"(options in=w6, timer=10, show timer progress bar?=TRUE) -> (options out=w7)
  call "Open Sweet Alert.gvi"(options=w7) -> (error out=w8)
  $"error out" <- w8
