vi "GET Submissions.gvi"   [G Web Development Software 22.0.0]
inputs:
  "Challenge ID": i64
outputs:
  "Error": error
  "Submissions JSON": string
uses:
  NI::HTTP::GET.gvi
  NI::G Core::Error::Build Error Cluster.gvi
diagram:
  Format Into String(formatString="/challenges/%d/submissions", $"Challenge ID") -> w1
  call "GET.gvi"(url=w1) -> (status code=w2, body=w3, error out=w4)
  case (w2) {
    frame Default {
      Format Into String(initString="Error %d\nUnable to retrieve submissions.", w2) -> w7
      call "Build Error Cluster.gvi"(error in=w4, code=1, description=w7) -> (error out=w5)
      w6 = "[]"
    }
    frame 200 {
      w5 = w4
      w6 = w3
    }
  }
  $"Submissions JSON" <- w6
  $Error <- w5
