vi "Show Submissions.gvi"   [G Web Development Software 22.0.0]
inputs:
  "Submissions JSON": string
  "Placeholder": "HtmlContainer reference"
uses:
  WebApp::Support::Submissions::Submissions.jsli::Show
diagram:
  Obtain JavaScript Reference(reference in=$Placeholder) -> (javascript reference out=w1)
  call "Show"(placeholder=w1, submissions=$"Submissions JSON")
