vi "UploadFile.gvi"   [G Web Development Software 22.0.0]
inputs:
  "File": "NI.JavaScriptReference"
  "Challenge ID": i64
  "CSRF Token": string
outputs:
  "error out": error
uses:
  Library::Support::GWebFormData.jsli::CreateFormData()
  Library::Support::GWebFormData.jsli::AppendRef
  Library::Support::GWebFormData.jsli::Append()
  Library::Support::GWebFormData.jsli::Send
  NI::G Core::Error::Build Error Cluster.gvi
diagram:
  Number To Decimal String(number=$"Challenge ID") -> (decimal integer string=w1)
  call "CreateFormData()"() -> (return=w2, error out=w3)
  call "AppendRef"(FormData=w2, name="file", file=$File, error in=w3) -> (return=w4, error out=w5)
  call "Append()"(FormData=w4, name="id", value=w1, error in=w5) -> (return=w6, error out=w7)
  call "Append()"(FormData=w6, name="csrf", value=$"CSRF Token", error in=w7) -> (return=w8, error out=w9)
  Concatenate Strings("/submit/", w1) -> w10
  call "Send"(FormData=w8, url=w10, method="POST", error in=w9) -> (return=w11, error out=w12)
  Is Not Equal(x="OK", y=w11) -> w13
  case (w13) {
    frame False, Default {
      w14 = w12
    }
    frame True {
      call "Build Error Cluster.gvi"(error in=w12, code=1, description=w11) -> (error out=w14)
    }
  }
  $"error out" <- w14
