vi "UploadFile.gvi"   [G Web Development Software 22.0.0]
inputs:
  "File": "NI.JavaScriptReference"
  "Challenge ID": i64
  "CSRF Token": string
outputs:
  "error out": error
uses:
  Library::Support::GWebFormData.jsli::CreateFormData()
  Library::Support::GWebFormData.jsli::AppendRef
  Library::Support::GWebFormData.jsli::Append()
  Library::Support::GWebFormData.jsli::Send
  NI::G Core::Error::Build Error Cluster.gvi
diagram:
  Number To Decimal String(number=$"Challenge ID") -> (decimal integer string=w1)
  call "CreateFormData()"() -> (return=w2, error out=w3)
  call "AppendRef"(FormData=w2, name="file", file=$File, error in=w3) -> (return=w4, error out=w5)
  call "Append()"(FormData=w4, name="id", value=w1, error in=w5) -> (return=w6, error out=w7)
  call "Append()"(FormData=w6, name="csrf", value=$"CSRF Token", error in=w7) -> (return=w8, error out=w9)
  call "Send"(FormData=w8, url="/submit", method="POST", error in=w9) -> (return=w10, error out=w11)
  Is Not Equal(x="OK", y=w10) -> w12
  case (w12) {
    frame False, Default {
      w13 = w11
    }
    frame True {
      call "Build Error Cluster.gvi"(error in=w11, code=1, description=w10) -> (error out=w13)
    }
  }
  $"error out" <- w13
