vi "admin.gviweb"   [G Web Development Software 22.0.0]
panel controls:
  "Filter Completed": bool
panel indicators:
  "Pending": T1[]
  "Running": T2[]
  "Done": T3[]
types:
  T1 = cluster{"ID": f64, "Challenge": string, "Approve": bool, "User": string, "Submitted": string}
  T2 = cluster{"ID": f64, "Challenge": string, "User": string, "Submitted": string}
  T3 = cluster{"ID": f64, "Challenge": string, "User": string, "Submitted": string, "Score": f64, "Summary": string}
uses:
  DataGridExtensions::RefByLabel.gvi
  DataGridExtensions::Activate Column.gvi
  WebApp::Support::Admin::Approve.gvi
  WebApp::Support::Admin::Populate Admin.gvi
  WebApp::Support::Auth::GET User Info.gvi
  WebApp::Support::Common.jsli::SetUser
diagram:
  w1 = 10000  # Normal Timeout
  w2 = 1  # First Iteration
  # Allow toggling the Approve column checkbox
  call "RefByLabel.gvi"(Label="Pending") -> (DataGridJSRef=w3)
  call "Activate Column.gvi"(DataGridJSRef In=w3, Index=2) -> (DataGridJSRef=w4)
  s1 = w2  # shift register
  while {
    event (timeout = s1) (after w4) {
      on "Pending" Value changed {
        Event Data() -> ("New Value"=w5)
        for {
          w6 = each element of w5
          Property Node(instance in=w6) -> ("ID"=w9, "Approve"=w10, instance out=w11)
          Not(x=w10) -> w12
          To Signed 64 Bit Integer(number=w9) -> w13
          w7 = w13 if w10
          append w11 to w8 if w12
        }
        Property Node(instance in=reference to "Pending", "Value"=w8)
        call "Approve.gvi"(Submission ID=w7)
      }
      on "Timeout" {
        call "Populate Admin.gvi"(Filter Completed=$"Filter Completed", Pending=reference to "Pending", Running=reference to "Running", Done=reference to "Done")
      }
    }
    next s1 = w1
    stop if FALSE
  }
  call "GET User Info.gvi"() -> (Logged In=w14, User JSON=w15)
  call "SetUser"(loggedIn=w14, userJSON=w15)
