vi "challenges.gviweb"   [G Web Development Software 22.0.0]
uses:
  WebApp::Support::Common.jsli::SetInnerHTML
  WebApp::Support::Auth::GET User Info.gvi
  NI::HTTP::GET.gvi
  WebApp::Support::Challenges::Challenges.jsli::BuildChallengesList
  WebApp::Support::Common.jsli::SetUser
  WebApp::Support::Common.jsli::ClearClassFromAll
diagram:
  s1 = "Init"  # shift register
  while {
    case (s1) {
      frame "Init" {
        Obtain JavaScript Reference(reference in=reference to "ChallengesList") -> (javascript reference out=w2)
        call "SetInnerHTML"(placeholder=w2, html="<div><p>Retrieving user info and challenges...</p></div>")
        Property Node(instance in=reference to unnamed text, "Visible"=FALSE)
        w1 = "Ready"
      }
      frame "Ready" {
        call "GET User Info.gvi"() -> (Logged In=w3, User JSON=w4)
        call "GET.gvi"(url="/challenges") -> (body=w5)
        Obtain JavaScript Reference(reference in=reference to "ChallengesList") -> (javascript reference out=w6)
        call "BuildChallengesList"(placeholder=w6, challengesJSON=w5, canSubmit=w3)
        call "SetUser"(loggedIn=w3, userJSON=w4) -> (error out=w7)
        call "ClearClassFromAll"(className="initially-hidden", error in=w7)
        Not(x=w3) -> w8
        Property Node(instance in=reference to unnamed text, "Visible"=w8)
        w1 = "Run"
      }
      frame "Run" {
        Wait(time to wait=100)
        w1 = "Run"
      }
    }
    next s1 = w1
    stop if FALSE
  }
