vi "index.gviweb"   [G Web Development Software 22.0.0]
uses:
  WebApp::Support::Common.jsli::SetInnerHTML
  WebApp::Support::Common.jsli::ClearClassFromAll
  WebApp::Support::Auth::GET User Info.gvi
  WebApp::Support::Common.jsli::SetUser
  WebApp::Support::Leaderboard::GET Leaderboard.gvi
  WebApp::Support::Leaderboard::Leaderboard.jsli::BuildLeaderboard
diagram:
  w1 = """The <b>Summer of LabVIEW</b> is a global NI Sales and Support event to increase <i>awareness, excitement</i>, and <i>prowess</i> with LabVIEW through a series of <b>coding challenges</b>, preceded by presentations and workshops teaching concepts that are applicable to the coding challenge tasks. Join the conversation about the event on <a href="https://web.yammer.com/main/org/ni.com/groups/eyJfdHlwZSI6Ikdyb3VwIiwiaWQiOiIxMDUxNDYzNzYxOTIifQ/all" target="_blank">our Yammer page</a>.<br>
<br>
You can also find information on our sharepoint where there are all of the training session recordings as well as recordings of challenge introductions and how to use the website: <a href="https://nio365.sharepoint.com/sites/SummerofLabVIEW" target="_blank">Summer of LabVIEW SharePoint</a>.<br>
<br>
To prepare for the event, you'll need to install LabVIEW 2020 or later. Download LabVIEW <a href="https://www.ni.com/en-us/support/downloads/software-products/download.labview.html#443865" target="_blank">here</a>.<br>
<br>
For the first challenge, you will also need to install DQMH from the VIPM Community <a href="https://www.vipm.io/package/delacor_lib_dqmh_toolkit/" target="_blank">here</a>.<br>
<br>
<hr>
<br>
This website is run on a web server written entirely in LabVIEW with the client side developed using the G Web Development software. You can find the source at <a href="https://github.com/illuminated-g/lv-sol-22" target="_blank">https://github.com/illuminated-g/lv-sol-22</a>. The underlying libraries used for the server will be available on VIPM this Summer."""
  Obtain JavaScript Reference(reference in=reference to "HTML Container") -> (javascript reference out=w2)
  call "SetInnerHTML"(placeholder=w2, html=w1)
  s1 = "Init"  # shift register
  s2 = uninitialised  # shift register
  while {
    case (s1) {
      frame "Init" {
        w3 = "Ready"
        w4 = default
      }
      frame "Ready" {
        call "ClearClassFromAll"(className="initially-hidden")
        call "GET User Info.gvi"() -> (Logged In=w5, User JSON=w6)
        call "SetUser"(loggedIn=w5, userJSON=w6)
        w3 = "Run"
        w4 = 1
      }
      frame "Run" {
        event (timeout = s2) {
          on "Timeout" {
            call "GET Leaderboard.gvi"() -> (Error=w7, Leaderboard JSON=w8)
            case (w7) {
              frame Error, Default { }
              frame No Error {
                Obtain JavaScript Reference(reference in=reference to "Scores") -> (javascript reference out=w9)
                call "BuildLeaderboard"(placeholder=w9, leaderboardJSON=w8)
              }
            }
          }
        }
        w3 = "Run"
        w4 = 240000
      }
    }
    next s1 = w3
    next s2 = w4
    stop if FALSE
  }
