vi "login.gviweb"   [G Web Development Software 22.0.0]
panel controls:
  "NI Email": string
  "Password": string
  "Login": bool
  "Register Link": string = "/register.html"
types:
  "Login JSON.gtype" = cluster{"Email": string, "Password": string, "CSRF": string}
uses:
  WebApp::Support::Auth::GET User Info.gvi
  URL::Window Location::Window Location Set.gvi
  WebApp::Support::Common.jsli::ClearClassFromAll
  WebApp::Support::Common.jsli::SetUser
  WebApp::Support::Auth::Make CSRF Token.gvi
  WebApp::Support::Auth::Login.gvi
diagram:
  call "GET User Info.gvi"() -> (Logged In=w1, User JSON=w2)
  case (w1) {
    frame False, Default { }
    frame True {
      call "Window Location Set.gvi"(url="/")
    }
  }
  call "ClearClassFromAll"(className="initially-hidden")
  call "SetUser"(loggedIn=w1, userJSON=w2)
  call "Make CSRF Token.gvi"(Token ID="login") -> (Token=w3, error out=w4)
  case (w4) {
    frame Error, Default { }
    frame No Error {
      while {
        event {
          on "Login" Value changed {
            Property Node(instance in="Login JSON.gtype" {all zero or empty}, "Email"=$"NI Email", "Password"=$Password, "CSRF"=w3) -> (instance out=w5)
            call "Login.gvi"(Login JSON=w5)
          }
        }
        stop if FALSE
      }
    }
  }
