vi "register.gviweb"   [G Web Development Software 22.0.0]
panel controls:
  "Email": string
  "Password": string
  "Confirm Password": string
  "First Name": string
  "Last Name": string
  "Department": string
  "Register": bool
types:
  "User Registration.gtype" = cluster{"Email": string, "Password 1": string, "Password 2": string, "First Name": string, "Last Name": string, "Department": string}
uses:
  WebApp::Support::Registration::Register User.gvi
  WebApp::Support::Registration::Failed Alert.gvi
  WebApp::Support::Registration::Success Alert.gvi
  URL::Window Location::Window Location Set.gvi
  WebApp::Support::Auth::GET User Info.gvi
  WebApp::Support::Common.jsli::SetUser
diagram:
  while {
    event {
      on "Register" Value changed {
        Property Node(instance in="User Registration.gtype" {all zero or empty}, "Email"=$Email, "Password 1"=$Password, "Password 2"=$"Confirm Password", "First Name"=$"First Name", "Last Name"=$"Last Name", "Department"=$Department) -> (instance out=w1)
        call "Register User.gvi"(User Registration=w1) -> (Result Message=w2, Success=w3)
        case (w3) {
          frame False, Default {
            call "Failed Alert.gvi"(Message=w2)
          }
          frame True {
            call "Success Alert.gvi"(User Registration=w1) -> (error out=w4)
            call "Window Location Set.gvi"(url="/login.html", error in=w4)
          }
        }
      }
    }
    stop if FALSE
  }
  call "GET User Info.gvi"() -> (Logged In=w5, User JSON=w6)
  call "SetUser"(loggedIn=w5, userJSON=w6)
