vi "submit.gviweb"   [G Web Development Software 22.0.0]
panel controls:
  "Upload File": bool
uses:
  WebApp::Support::Common.jsli::AddNavLink
  URL::Window Location::Window Location Parameters::Window Location Get Search Parameter.gvi
  WebApp::Support::Common.jsli::SetInnerHTML
  WebApp::Support::Challenges::GET Challenge by ID.gvi
  WebApp::Support::Challenges::Set Challenge Details.gvi
  WebApp::Support::Submissions::GET Submissions.gvi
  WebApp::Support::Submissions::Show Submissions.gvi
  WebApp::Support::Common.jsli::ClearClassFromAll
  WebApp::Support::Auth::Make CSRF Token.gvi
  Uppy::Set Uppy Core Options.gvi
  Uppy::Set Uppy Dashboard Options.gvi
  Uppy::Request Files.gvi
  WebApp::Support::Submissions::UploadFile.gvi
diagram:
  w1 = """There was an error loading the specified challenge. Try reloading the page.

If the problem persists check out the <a href="/help.html">help</a> page."""
  s1 = "Init"  # shift register
  s2 = uninitialised  # shift register
  s3 = uninitialised  # shift register
  s4 = uninitialised  # shift register
  while {
    case (s1) {
      frame "Init" {
        call "AddNavLink"(url="/help.html", text="Help!")
        call "Window Location Get Search Parameter.gvi"(key="id") -> (value=w6)
        Decimal String To Number(default (0 I32)=0, string=w6) -> (number=w4)
        w2 = "Ready"
        w3 = default
        w5 = default
      }
      frame "Ready" {
        Is Greater Than 0(x=s3) -> w7
        case (w7) {
          frame False, Default {
            Obtain JavaScript Reference(reference in=reference to "Description") -> (javascript reference out=w8)
            call "SetInnerHTML"(placeholder=w8, html=w1)
          }
          frame True {
            call "GET Challenge by ID.gvi"(ID=s3) -> (Challenge=w9, Found?=w10)
            Obtain JavaScript Reference(reference in=reference to "Description") -> (javascript reference out=w11)
            case (w10) {
              frame False, Default {
                call "SetInnerHTML"(placeholder=w11, html=w1)
              }
              frame True {
                call "Set Challenge Details.gvi"(Challenge=w9, Desc Ref=w11, Name Ref=reference to unnamed text)
                call "GET Submissions.gvi"(Challenge ID=s3) -> (Submissions JSON=w12, Error=w13)
                case (w13) {
                  frame Error, Default {
                    w14 = "initially-hidden"
                  }
                  frame No Error {
                    call "Show Submissions.gvi"(Placeholder=reference to "Submissions", Submissions JSON=w12)
                    w14 = "initially-hidden"
                  }
                }
                call "ClearClassFromAll"(className=w14)
              }
            }
          }
        }
        call "Make CSRF Token.gvi"(Token ID="submit") -> (Token=w3)
        w2 = "Run"
        w4 = s3
        w5 = default
      }
      frame "Run" {
        event (timeout = s4) {
          on "Upload File" Value changed {
            # Trigger update right away
            call "Set Uppy Core Options.gvi"(max number of files=1, allowed file types=[".llb"]) -> (uppy options out=w15)
            call "Set Uppy Dashboard Options.gvi"(uppy options in=w15, show uppy icon?=FALSE) -> (uppy options out=w16)
            call "Request Files.gvi"(uppy options=w16) -> (file references=w17)
            Array Index(array=w17) -> (out0[_]=w18)
            call "UploadFile.gvi"(File=w18, Challenge ID=s3, CSRF Token=s2) -> (error out=w19)
            case (w19) {
              frame Error, Default {
                Property Node(instance in=w19) -> ("source"=w20)
                One Button Dialog(message=w20)
              }
              frame No Error { }
            }
            w4 = s3
            w3 = s2
            w5 = 0
          }
          on "Timeout" {
            call "GET Submissions.gvi"(Challenge ID=s3) -> (Submissions JSON=w21, Error=w22)
            # Every 10 seconds, automatically check for submission updates.
            case (w22) {
              frame Error, Default {
                Property Node(instance in=w22) -> ("source"=w23)
                One Button Dialog(message=w23)
              }
              frame No Error {
                call "Show Submissions.gvi"(Placeholder=reference to "Submissions", Submissions JSON=w21)
              }
            }
            w4 = s3
            w3 = s2
            w5 = 10000
          }
        }
        w2 = "Run"
      }
    }
    next s1 = w2
    next s2 = w3
    next s3 = w4
    next s4 = w5
    stop if FALSE
  }
